# Grasshopper definition RDGrid.gh (Grasshopper 1.0.7)

file_path = FilePath("G:\Mi unidad\Barcelona MPDA\Universidad\2nd Semester\Algorithmics in Techonology\AT AP\GitHub\MPDA_AT.AP\RDGrid.py")
iter = Slider(0, range=0..1000)
amp = Slider(2, range=0..10)
ysize = Slider(1, range=0..10)
number_slider = Slider(100, range=0..200)
compucurves = BooleanToggle(False)
compusrf = BooleanToggle(False)
read_file = ReadFile(File=file_path, PerLineParse=False)
ghpython_script = GhPythonScript(
    Code=read_file,
    Width=number_slider,
    Heigth=number_slider,
    Iter=iter,
    XSize=ysize,
    YSize=ysize,
    Amp=amp,
    CompuCurves=compucurves,
    CompuSrf=compusrf)  # -> Out, Grid, Curves, Srf, Mesh
point = Point(ghpython_script.Grid)
curve = Curve(ghpython_script.Curves)
surface = Surface(ghpython_script.Srf)
mesh = Mesh(ghpython_script.Mesh)
